# Grasshopper definition curveSurfaceIGA.gh (Grasshopper 1.0.7)
# plug-ins: Kiwi3d

surfacerefinement = SurfaceRefinement(PDeg=3, QDeg=3, ElementRefU=5, ElementRefV=5, IsKnotApproxElementSize=False, IsKnotSubdivision=True)
value_list = ValueList({"STEEL": 1, "WOOD": 2, "GFRP": 3, "ETFE (Membrane)": 4, "CONCRETE": 5, "ALUMINIUM": 6}, selected="STEEL")
materialdefaults = MaterialDefaults(Type=value_list, IsNmm2=False, IskNcm2=False, IskNm2=True, mUnit=1)  # -> Material, YoungsModulus, AlphaT, Nue, Density, Strength
brep = Brep(<brep referenced from the Rhino model>)
value_list_2 = ValueList({"DEAD": 1, "SNOW": 2, "PRES": 3, "PRES_FL": 4}, selected="PRES")
curve = Curve([<curve referenced from the Rhino model> x2])

supportcurve = SupportCurve(Crv=curve, DispX=True, DispY=True, DispZ=True, Rot=False)
shell_element = ShellElement(
    Brep=brep,
    Material=materialdefaults.Material,
    Thickness=Slider(0.01, range=0..0.01),
    Refinement=surfacerefinement,
    HingeCoupling=False)
surface_load = SurfaceLoad(Brep=brep, Loadtype=value_list_2, Direction=Vector(0, 0, -1), Value=10, LoadCase=1)
value_list_3 = ValueList({"Displacements": 1, "Stresses": 2, "SupportForces": 3}, selected=["Displacements", "Stresses", "SupportForces"])

linear_analysis = LinearAnalysis(Name="MyAnalysis", OutputSetting=value_list_3)
analysismodel = AnalysisModel(
    Analysis=linear_analysis,
    StructuralElements=shell_element,
    Supports=supportcurve,
    Loads=surface_load,
    IntersectionTolerance=0.01,
    IsCarat=True,
    IsKratos=False,
    PenaltyFac=10000000,
    ShowCouplingIDs=False,
    ShowEdgeIDs=False,
    ShowGeo=False,
    ShowPatchIDs=True,
    ShowPrePro=True,
    ShowRef=False)
run_analysis = IGASolver(AnalysisModel=analysismodel, Run=Toggle(False), antiFreeze=False, showWindow=True)  # -> ResultModel, ErrorReport

deformedmodel = DeformedModel(Model=run_analysis.ResultModel, ScaleFactor=Slider(10, range=1..10), FlyingNodeLimit=100000)  # -> Model, Geo, DeformedStructuralElements
value_list_4 = ValueList({"X Displacement": 1, "Y Displacement": 2, "Z Displacement": 3, "Displacement Length": 4, "P_N1": 5, "P_N2": 6, "N1": 7, "N2": 8, "N12": 9, "P_M1 (Shell)": 10, "P_M2 (Shell)": 11, "M1 (Shell)": 12, "M2 (Shell)": 13, "M12 (Shell)": 14, "von_Mises (Shell)": 15}, selected="Z Displacement")

_2d_element_result_colour_plot = _2DElementResultColourPlot(Model=deformedmodel.Model, Type=value_list_4, VisMeshCoarse=True, VisMeshSmooth=False)  # -> Model, Mesh, ValueDomain, LegendC, LegendT
surface_points = SurfacePoints(Surface=deformedmodel.Geo)  # -> Points, Weights, Greville, UCount, VCount
