# Grasshopper definition planesurfaceIGA.gh (Grasshopper 1.0.7)
# plug-ins: Kiwi3d

value_list = ValueList({"STEEL": 1, "WOOD": 2, "GFRP": 3, "ETFE (Membrane)": 4, "CONCRETE": 5, "ALUMINIUM": 6}, selected="STEEL")
point = Point([<point referenced from the Rhino model> x2])

surfacerefinement = SurfaceRefinement(PDeg=3, QDeg=3, ElementRefU=5, ElementRefV=5, IsKnotApproxElementSize=False, IsKnotSubdivision=True)
point_2 = Point([<point referenced from the Rhino model> x4])
curve = Curve(<curve referenced from the Rhino model>)
brep = Brep(<brep referenced from the Rhino model>)

materialdefaults = MaterialDefaults(Type=value_list, IsNmm2=False, IskNcm2=False, IskNm2=True, mUnit=1)  # -> Material, YoungsModulus, AlphaT, Nue, Density, Strength
surface = Surface(<surface referenced from the Rhino model>)
supportpoint = SupportPoint(Point=[point_2, point], DispX=True, DispY=True, DispZ=True, Rotation=False, Torsion=False)
curve_load = CurveLoad(Crv=curve, Loadtype="DEAD", Direction=Vector(0, 0, -1), Value=Slider(23, range=0..100), LoadCase=1)
shell_element = ShellElement(
    Brep=[surface, brep],
    Material=materialdefaults.Material,
    Thickness=0.1,
    Refinement=surfacerefinement,
    HingeCoupling=False)
value_list_2 = ValueList({"Displacements": 1, "Stresses": 2, "SupportForces": 3}, selected=["Displacements", "Stresses"])
linear_analysis = LinearAnalysis(Name="MyAnalysis", OutputSetting=value_list_2)
analysismodel = AnalysisModel(
    Analysis=linear_analysis,
    StructuralElements=shell_element,
    Supports=supportpoint,
    Loads=curve_load,
    IntersectionTolerance=0.01,
    IsCarat=True,
    IsKratos=False,
    PenaltyFac=10000000,
    ShowCouplingIDs=False,
    ShowEdgeIDs=False,
    ShowGeo=False,
    ShowPatchIDs=True,
    ShowPrePro=True,
    ShowRef=False)
analysis_completed = IGASolver(AnalysisModel=analysismodel, Run=Toggle(True), antiFreeze=False, showWindow=True)  # -> ResultModel, ErrorReport
deformedmodel = DeformedModel(Model=analysis_completed.ResultModel, ScaleFactor=Slider(6, range=0..100), FlyingNodeLimit=100000)  # -> Model, Geo, DeformedStructuralElements
value_list_3 = ValueList({"X Displacement": 1, "Y Displacement": 2, "Z Displacement": 3, "Displacement Length": 4, "P_N1": 5, "P_N2": 6, "N1": 7, "N2": 8, "N12": 9, "P_M1 (Shell)": 10, "P_M2 (Shell)": 11, "M1 (Shell)": 12, "M2 (Shell)": 13, "M12 (Shell)": 14, "von_Mises (Shell)": 15}, selected="von_Mises (Shell)")
_2d_element_result_colour_plot = _2DElementResultColourPlot(Model=deformedmodel.Model, Type=value_list_3, VisMeshCoarse=True, VisMeshSmooth=False)  # -> Model, Mesh, ValueDomain, LegendC, LegendT
